# Dynamo graph Demo.dyn (Dynamo 1.3.1.1736)

noteOut = Dynamidi.Dynamidi.NoteOut()
watch = Watch(noteOut)
getDevice = Dynamidi.Dynamidi.getDevice()
deviceOpen = Dynamidi.Dynamidi.deviceOpen(getDevice)
deviceStart = Dynamidi.Dynamidi.deviceStart(deviceOpen)
isReceiving = Dynamidi.Dynamidi.isReceiving(deviceStart)
cc_channelOut = Dynamidi.Dynamidi.cc_channelOut()
watch_2 = Watch(cc_channelOut)
cc_valueOut = Dynamidi.Dynamidi.cc_valueOut()
watch_3 = Watch(cc_valueOut)
cc_controlOut = Dynamidi.Dynamidi.cc_controlOut()
watch_4 = Watch(cc_controlOut)
